# Requirement set SystemRequirements (R2018b)

## 1 [#1] Sensors (Container)

### 1.1 [#2] Proximity Sensors
The Self Navigating Robot shall have three digital switch sensors.

## 2 [#5] Actuation (Container)

### 2.1 [#4] Actuation
The Self Navigating Robot shall use two motors for steering and drive control.

## 3 [#6] Control (Container)

### 3.1 [#12] Manage motors
The Controller shall manage the demands to the motors depending on the sensor measurements.